# Grasshopper definition script.gh (Grasshopper 1.0.8)
# plug-ins: tOpos, Human

# ----
# DOMAIN - MESH
brep = Brep(<brep referenced from the Rhino model>)
mesh_brep = MeshBrep(
    Brep=brep,
    Settings={GridMaxCount=0, GridMinCount=16, JaggedSeams=False, MaxEdgeLength=0, MinEdgeLength=0.0001, MinTolerance=0, Refine=True, RefineAngle=0, RelativeTolerance=0.65, SimplePlanes=True, Tolerance=0})

# ----
# SUPPORTS - MESH
brep_2 = Brep(<brep referenced from the Rhino model>)
mesh_brep_2 = MeshBrep(
    Brep=brep_2,
    Settings={GridMaxCount=0, GridMinCount=16, JaggedSeams=False, MaxEdgeLength=0, MinEdgeLength=0.0001, MinTolerance=0, Refine=True, RefineAngle=0, RelativeTolerance=0.65, SimplePlanes=True, Tolerance=0})

# ----
# LOADS
surface = Surface(<surface referenced from the Rhino model>)
surface_2 = Surface(<surface referenced from the Rhino model>)
surface_load = SurfaceLoad(LoadSurface=surface_2, LoadValue="-500")
surface_load_2 = SurfaceLoad(LoadSurface=surface, LoadValue="-500")

young_ingpa = Slider(70, range=0..1000)
targetdens = Slider(0.1, range=0..1)
poisson = Slider(0.3, range=0..1)

# ----
# RESOLUTION
panel = Panel("20")
resolution = Resolution(ResolutionX=panel, sizeModeToggle=False)

# ----
# Loads and supports must lie within the domain.
# When giving loas values, take into account model units.
# tOpos
# Take into account model units...
bounding_box = BoundingBox(Content=mesh_brep, Plane=PlaneXY(0, 0, 0))  # -> Box, Box_2
box_corners = BoxCorners(Box=bounding_box.Box)  # -> CornerA, CornerB, CornerC, CornerD, CornerE, CornerF, CornerG, CornerH
point = Point(box_corners.CornerA)
point_2 = Point(box_corners.CornerG)
deconstruct = Deconstruct(Point=point)  # -> XComponent, YComponent, ZComponent
deconstruct_2 = Deconstruct(Point=point_2)  # -> XComponent, YComponent, ZComponent
boundary_conditions = BoundaryConditions(Load=[surface_load_2, surface_load], Support=mesh_brep_2)
subtraction = Subtraction(A=deconstruct_2.XComponent, B=deconstruct.XComponent)
subtraction_2 = Subtraction(A=deconstruct_2.YComponent, B=deconstruct.YComponent)
# APOYOS_06
subtraction_3 = Subtraction(A=deconstruct_2.ZComponent, B=deconstruct.ZComponent)
optimius_parameters = OptimiusParameters(
    OptimisationIteration=Slider(50, range=0..100),
    VolumeFraction=targetdens,
    Penalty=Domain(2, 3),
    Change=0.005,
    SensitivityFilterRadius=Domain(1.5, 1.5),
    DensityFilterType=0,
    GrayScaleFilter=False,
    HeavisideProjection=0,
    SensitivityFilterType=1)
boundary_domain = BoundaryDomain(DomainMesh=mesh_brep, DensityValue=targetdens, YoungModul=young_ingpa, PoissonNumber=poisson)
panel_2 = Panel(subtraction)
panel_3 = Panel(subtraction_2)
panel_4 = Panel(subtraction_3)
division = Division(A=panel_2, B=panel)
voxel_size = Panel(division)
model = Model(BoundaryDomain=boundary_domain, BoundaryCondition=boundary_conditions, ModelResolution=resolution, gpuModeToggle=True)  # -> Model, Performance
analyser_parameters = AnalyserParameters(Iterations=5000, Tolerance=0.001)
reset = Button()
run = BooleanToggle(False)
division_2 = Division(A=panel_2, B=voxel_size)
division_3 = Division(A=panel_3, B=voxel_size)
division_4 = Division(A=panel_4, B=voxel_size)
model_statistics = ModelStatistics(Model=model.Model)  # -> ModelResolution, ElementCount, ElementSize, NodeCount, DoFs
optimus = Optimus(
    Model=model.Model,
    AnalyserParameters=analyser_parameters,
    OptimusParameters=optimius_parameters,
    SubdivisionThreshold=0.5,
    Reset=reset,
    Run=run,
    optimisationPreviewMode=True,
    solverType=0)  # -> Model, Compliance, Performance
panel_5 = Panel([model_statistics.ModelResolution, model_statistics.ElementCount, model_statistics.ElementSize, model_statistics.NodeCount, model_statistics.DoFs])
quick_graph = QuickGraph(optimus.Compliance, SortOrder=0)
voxel_mesh = VoxelMesh(Model=optimus.Model, Threshold=Slider(0.1, range=0..1), asOneMeshMode=True, densityPreviewMode=False)
data_dam = DataDam(DataDataA=optimus.Model, BufferDelay=10000000, BufferMode=0)
reset_cuda = Button()
cudactx = CudaCtx(Reset=reset_cuda)  # -> Performance, FreeMemory, KernelStatistics
principalstress = PrincipalStress(Model=data_dam, Tolerance=Slider(0, range=0..1))  # -> PStressValues, PStressPlane, PStressCrosses, PStressCrossesColours, PStressMinMax, VonMiesesValues, VonMiesesCrossesColours, Performance
free_memory_in_mb = Panel(cudactx.FreeMemory)
deconstruct_plane = DeconstructPlane(Plane=principalstress.PStressPlane)  # -> Origin, XAxis, YAxis, ZAxis

voxels_z = Panel(division_4)
voxels_x = Panel(division_2)
voxels_y = Panel(division_3)

# ----
# Internalise data
point_3 = Point(deconstruct_plane.Origin)
number = Number(principalstress.VonMiesesValues)
number_2 = Number([5202296.118, 4640403.551, 1773347.528, 83140.49349, 208.0843886, 229.8667372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])
point_4 = Point([Point(0.5, 0.5, 0.5), Point(1.5, 0.5, 0.5), Point(2.5, 0.5, 0.5), Point(3.5, 0.5, 0.5), Point(4.5, 0.5, 0.5), Point(5.5, 0.5, 0.5)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])

# ----
# % VALUES --> GROUPS
panel_6 = Panel("""0
5
25
45
65
101""")

# ----
# Minimum value filter
panel_7 = Panel("2000")
average = Average(Input=number_2)
larger_than = LargerThan(FirstNumber=number_2, SecondNumber=panel_7)  # -> LargerThan, OrEqualTo
panel_8 = Panel(average)

# ---- group: FINAL POINTS/VALUES
cull_pattern = CullPattern(List=point_4, CullPattern=larger_than.LargerThan)
cull_pattern_2 = CullPattern(List=number_2, CullPattern=larger_than.LargerThan)

# ----
# VOXELS
bounds = Bounds(Numbers=number_2)
deconstruct_domain = DeconstructDomain(Domain=bounds)  # -> Start, End

panel_9 = Panel(deconstruct_domain.End)

construct_domain = ConstructDomain(DomainStart=0, DomainEnd=panel_9)
remap_numbers = RemapNumbers(Value=reverse(panel_6), Source="0 to 100", Target=construct_domain)  # -> Mapped, Clipped
consecutive_domains = ConsecutiveDomains(Numbers=remap_numbers.Mapped, Additive=False)
find_domain = FindDomain(Domains=consecutive_domains, Number=cull_pattern_2, Strict=False)  # -> Index, Neighbour
python_3_script = Python3Script(pts=cull_pattern, idxs=find_domain.Index)  # -> out, pts_tree; inputs pts: list, idxs: list
# ---------- python_3_script: Python ----------
import Grasshopper as gh
from Grasshopper.Kernel.Data import GH_Path
from Grasshopper import DataTree

pts_tree = DataTree[object]()

for pt,i in zip(pts,idxs):
    path = GH_Path(i)
    pts_tree.Add(pt, path)
# ---------- end python_3_script ----------
move = Move(Motion=python_3_script.pts_tree)  # -> Geometry, Transform

# ----
# VISUALIZATION
bounds_2 = Bounds(Numbers=find_domain.Index)
deconstruct_domain_2 = DeconstructDomain(Domain=bounds_2)  # -> Start, End
gradient = Gradient(
    LowerLimit=deconstruct_domain_2.Start,
    UpperLimit=deconstruct_domain_2.End,
    Parameter=find_domain.Index,
    stops=[0: RGB(0, 128, 0), 0.5: RGB(255, 255, 0), 1: RGB(255, 0, 0)])
custom_preview = CustomPreview(Geometry=cull_pattern, Material=gradient)

# ----
# NUMBER OF GROUPS
# NUMBER OF VOXEL BLOCKS
list_length = ListLength(List=consecutive_domains)
panel_10 = Panel(list_length)

# ----
# VOXELS CREATION
panel_11 = Panel("""vx00
vx01
vx02
vx03
vx04""")
graft_tree = GraftTree(Tree=panel_11, IncludeEmptyLists=True, IncludeNullItems=True)  # -> simplify(Tree)
# N/mm2
# Resistencia de cálculo
placeblock = PlaceBlock(BlockName=graft_tree, Transform=move.Transform, Bake=Button())
